# Grasshopper definition IK.gh (Grasshopper 1.0.7)
# plug-ins: NGon

segment_length = Slider(70.4, range=0..100)
segment_count = Slider(8, range=0..10)
target_point = Point(Point(44.19821541, -25.17621596, 88.77756208))
c_script = CSharpScript(SegmentLength=segment_length, SegmentCount=segment_count, TargetPoint=target_point, Reset=Button())  # -> out, LinesOut; inputs SegmentLength: Double, SegmentCount: Int32, TargetPoint: Point3d, Reset: Boolean
# ---------- c_script: C# ----------
    if (initialized && (!Reset))
    {
      // Do nothing
    }
    else
    {
      rArm = new RobotArm(SegmentCount, SegmentLength, TargetPoint);
      initialized = true;
    }
    rArm.TargetPoint = TargetPoint;
    rArm.Update();
    LinesOut = rArm.Show();
# ---------- c_script: C# additional code ----------
  public bool initialized = false;
  public RobotArm rArm;

  public class RobotArm
  {
    // Properties
    public List<Segment> Segments {get; set;}
    public Point3d TargetPoint {get; set;}

    // Constructor
    public RobotArm(int numSeg, double segLen, Point3d targetPt)
    {
      this.Segments = new List<Segment>();
      // Add the first segment
      Segment seg1 = new Segment(segLen, 0);
      this.Segments.Add(seg1);
      // for (variables; condition; change;)
      for (var x = 0; x < numSeg; x++)
      {
        // Add a segment
        Segment seg = new Segment(segLen, (x + 1));
        this.Segments[x].ParentSegment = seg;
        this.Segments.Add(seg);
      }
      this.TargetPoint = targetPt;
    }

    // Functions
    public void Update()
    {
      // For each Segment, Update A Vector;
      for (var i = 0; i < this.Segments.Count; i++)
      {
        if (i == 0)
        {
          this.Segments[i].UpdateA((this.TargetPoint - Point3d.Origin));
        }
        else
        {
          this.Segments[i].UpdateA(this.Segments[i - 1].A);
        }
      }
      // For the last Segment, Update it's B Vector;
      this.Segments[this.Segments.Count - 1].A = Vector3d.Zero;
      this.Segments[this.Segments.Count - 1].UpdateB();
      // For each Segment, Update B Vector;
      for (var i = (this.Segments.Count - 2); i >= 0; i--)
      {
        this.Segments[i].A = this.Segments[i + 1].B;
        this.Segments[i].UpdateB();
      }
    }

    public List<Line> Show()
    {
      List<Line> lOut = new List<Line>();
      // For each Segment, call Segment.Show();
      for (var i = 0; i < this.Segments.Count; i++)
      {
        lOut.Add(this.Segments[i].Show());
      }
      return lOut;
    }

  }

  public class Segment
  {
    // Properties
    public Vector3d A {get; set;}
    public Vector3d B {get; set;}
    public double Length {get; set;}
    public int Index {get; set;}
    public Vector3d Diff {get; set;}
    public Segment ParentSegment {get; set;}

    // Constructor
    public Segment(double len, int ind)
    {
      this.Length = len;
      this.Index = ind;
      this.ParentSegment = null;
    }

    // Functions
    public void UpdateA(Vector3d target)
    {
      if (this.ParentSegment != null)
      {
        Vector3d dir = Vector3d.Subtract(target, this.A);
        dir.Unitize();
        this.Diff = dir;
        dir = Vector3d.Multiply(dir, this.Length);
        dir = Vector3d.Negate(dir);
        this.A = Vector3d.Add(target, dir);
      }
    }

    public void UpdateB()
    {
      this.B = ((this.A) + (this.Diff * this.Length));
    }

    public Line Show()
    {
      return new Line((Point3d.Origin + this.A), (Point3d.Origin + this.B));
    }

    public static double GetAngleBetween(Vector3d x, Vector3d y)
    {
      double angleOut = 0.0;
      angleOut = Vector3d.VectorAngle(x, y);
      x.Rotate(RhinoMath.ToRadians(90), Vector3d.ZAxis);
      if (Vector3d.Multiply(x, y) < 0) angleOut = (angleOut * (-1));
      return angleOut;
    }
  }
# ---------- end c_script ----------
panel = Panel(c_script.out)
panel_2 = Panel(c_script.LinesOut)
join_curves = JoinCurves(Curves=c_script.LinesOut, Preserve=False)
end_points = EndPoints(Curve=join_curves)  # -> Start, End
meshpipe = MeshPipe(Curve=join_curves, Radius=Slider(5, range=0..10), Sides=6, Tolerance=10, Ending=2)
point = Point(end_points.End)
distance = Distance(PointA=target_point, PointB=point)
data_recorder = DataRecorder(point, DataLimit=-10, RecordData=True)
panel_3 = Panel(distance)
interpolate = Interpolate(Vertices=data_recorder, Degree=3, Periodic=False, KnotStyle=1)  # -> Curve, Length, Domain
