# Grasshopper definition boids.gh (Grasshopper 1.0.7)

number_slider = Slider(50, range=0..100)
center_box = CenterBox(Base=PlaneXY(0, 0, 0), X=number_slider, Y=number_slider, Z=number_slider)
populate_3d = Populate3D(Region=center_box, Count=100, Seed=1)
timer = Timer(TimerInterval=1000, Target=c_script)
c_script = CSharpScript(
    StartPoints=populate_3d,
    AttractionFactor=Slider(0.5, range=0..1),
    OrientationFactor=Slider(0.5, range=0..1),
    RepulsionFactor=Slider(0.5, range=0..1),
    Seed=Slider(67, range=0..100),
    Reset=Button())  # -> out, Representations; inputs StartPoints: list of Point3d, AttractionFactor: Double, OrientationFactor: Double, RepulsionFactor: Double, Seed: Int32, Reset: Boolean
# ---------- c_script: C# ----------
    if (initialized && (!Reset))
    {
      //Do nothing
    }
    else
    {
      boidsInstance = new Boids(StartPoints, AttractionFactor, OrientationFactor, RepulsionFactor, Seed);
    }
    List<string> st = boidsInstance.Update();
    foreach (string s in st)
    {
      Print(s);
    }
    Representations = boidsInstance.Show();
    //Print(v.ToString());
# ---------- c_script: C# additional code ----------
  public bool initialized = false;
  public static Boids boidsInstance;
  public static int v = 0;

  public class Boids
  {
    public List<Boid> BoidsList {get; set;}

    public Boids(List<Point3d> startPts, double attF, double oriF, double repF, int seed)
    {
      this.BoidsList = new List<Boid>();
      for (int i = 0; i < (startPts.Count); i++)
      {
        this.BoidsList.Add(new Boid(startPts[i], attF, oriF, repF, seed));
      }
    }

    public List<string> Update()
    {
      List<string> stat = new List<string>();
      for (int i = 0; i < this.BoidsList.Count; i++)
      {
        this.BoidsList[i].Update();
        stat.Add(this.BoidsList[i].Position.ToString() + " | " + this.BoidsList[i].Velocity.ToString());
      }
      return stat;
    }

    public List<Line> Show()
    {
      List<Line> lOut = new List<Line>();
      for (int i = 0; i < this.BoidsList.Count; i++)
      {
        lOut.Add(new Line(this.BoidsList[i].Position, this.BoidsList[i].Velocity));
      }
      return lOut;
    }
  }

  public class Boid
  {
    public Point3d Position {get; set;}
    public Vector3d Velocity {get; set;}
    public Vector3d Acceleration {get; set;}
    public double AttractionFactor {get; set;}
    public double OrientationFactor {get; set;}
    public double RepulsionFactor {get; set;}

    public Boid(Point3d initPos, double attF, double oriF, double repF, int seed)
    {
      this.Position = initPos;
      this.AttractionFactor = attF;
      this.OrientationFactor = oriF;
      this.RepulsionFactor = repF;
      this.Acceleration = RandomVector(seed);
      this.Velocity = RandomVector(seed);
    }

    public void Update()
    {
      // Update Position & direction
      this.Velocity = RandomVector(DateTime.Now.Millisecond);
      Point3d iPos = this.Position;
      this.Position = iPos + this.Velocity;
      v += 1;
      // Update Acceleration
      //Vector3d a = Attraction();
      //Vector3d r = Repulsion();
      //Vector3d o = Orientation();
      this.Acceleration = RandomVector(DateTime.Now.Millisecond);
    }

    public Vector3d Attraction()
    {

      return RandomVector(DateTime.Now.Millisecond);
    }

    public Vector3d Repulsion()
    {
      return RandomVector(DateTime.Now.Millisecond);
    }

    public Vector3d Orientation()
    {
      return RandomVector(DateTime.Now.Millisecond);
    }

    public Line Show()
    {
      return new Line(this.Position, this.Velocity);
    }

  }

  public static Vector3d RandomVector(int seed)
  {
    Random rand = new Random(seed);
    double x = rand.NextDouble();
    double y = rand.NextDouble();
    double z = rand.NextDouble();
    Vector3d vOut = new Vector3d(x, y, z);
    vOut.Unitize();
    return vOut;
  }
# ---------- end c_script ----------
panel = Panel(c_script.out)
